# Grasshopper definition Task1.gh (Grasshopper 1.0.8)

rotation = Slider(4.3, range=0..10)
bottom_polygon_side_num = Slider(5, range=0..10)
segment_offset = Slider(2, range=0..10)
side_increase = Slider(0, range=0..10)
segments = Slider(40, range=0..100)
radius = Slider(33, range=0..50)
series = Series(Start=0, Step=rotation, Count=segments)
series_2 = Series(Start=bottom_polygon_side_num, Step=side_increase, Count=segments)
series_3 = Series(Start=0, Step=segment_offset, Count=segments)
bounds = Bounds(Numbers=series)
polygon = Polygon(Plane=PlaneXY(0, 0, 0), Radius=radius, Segments=series_2, FilletRadius=0)  # -> Polygon, Length
construct_point = ConstructPoint(XCoordinate=0, YCoordinate=0, ZCoordinate=0)
unit_z = UnitZ(Factor=series_3)
remap_numbers = RemapNumbers(Value=series, Source=bounds, Target=Domain(0, 1))  # -> Mapped, Clipped
move = Move(Geometry=polygon.Polygon, Motion=unit_z)  # -> Geometry, Transform
move_2 = Move(Geometry=construct_point, Motion=unit_z)  # -> Geometry, Transform
graph_mapper = GraphMapper(
    remap_numbers.Mapped,
    x0=0,
    x1=1,
    y0=0,
    y1=1,
    container_name="Sinc",
    Equation_X0=0.4718452692,
    Equation_X1=0.6371169686,
    Equation_Y0=0.3488596678,
    Equation_Y1=0.8204743862)
rotate = Rotate(Geometry=move.Geometry, Angle=degrees(series), Plane=PlaneXY(0, 0, 0))  # -> Geometry, Transform
scale = Scale(Geometry=rotate.Geometry, Center=move_2.Geometry, Factor=graph_mapper)  # -> Geometry, Transform
explode = Explode(Curve=scale.Geometry, Recursive=True)  # -> Segments, Vertices
loft = Loft(Curves=scale.Geometry, Options={Adjust=False, Closed=False, LoftEnds=0, LoftSimp=0, LoftType=0, Rebuild=10, Refit=0.01})
flip_matrix = FlipMatrix(Data=explode.Vertices)
point_on_curve = PointOnCurve(explode.Segments, parameter=1)
thickness = Slider(0.1, range=0..1)
flip_matrix_2 = FlipMatrix(Data=point_on_curve)
polyline = PolyLine(Vertices=flip_matrix, Closed=False)
boundary_surfaces = BoundarySurfaces(Edges=scale.Geometry)
polyline_2 = PolyLine(Vertices=flip_matrix_2, Closed=False)
unit_z_2 = UnitZ(Factor=thickness)
pipe_radius = Slider(1, range=0..3)
data_dam = DataDam(DataDataA=[polyline, polyline_2], BufferDelay=10000000, BufferMode=0)
extrude = Extrude(Base=boundary_surfaces, Direction=unit_z_2)
pipe = Pipe(Curve=data_dam, Radius=pipe_radius, Caps=0)

number_of_slices = Slider(43, range=0..100)
number_slider = Slider(0, range=0..100)
series_4 = Series(Start=number_slider, Step=Slider(5.2956, range=0..20), Count=number_of_slices)
construct_point_2 = ConstructPoint(XCoordinate=Slider(10, range=0..10), YCoordinate=number_slider, ZCoordinate=series_4)
xy_plane = XYPlane(Origin=construct_point_2)

mesh = Mesh()
mesh_plane = MeshPlane(Mesh=mesh, Plane=xy_plane)
point = Point([<point referenced from the Rhino model> x60])
boundary_surfaces_2 = BoundarySurfaces(Edges=mesh_plane)
shortest_list = ShortestList(ListListA=scale.Geometry, ListListB=point, TrimMode=2)  # -> ListListA, ListListB
series_5 = Series(Start=0, Step=1, Count=Slider(56, range=0..100))
area = Area(Geometry=scale.Geometry)  # -> Area, Centroid
vector_2pt = Vector2Pt(PointA=area.Centroid, PointB=shortest_list.ListListB, Unitize=False)  # -> Vector, Length
text_tag_3d = TextTag3D(Location=point, Text=series_5, Size=Slider(8.12, range=0..50), Justification=5)
move_3 = Move(Geometry=scale.Geometry, Motion=vector_2pt.Vector)  # -> Geometry, Transform
point_list = PointList(Points=area.Centroid)
