# Grasshopper definition Task1.gh (Grasshopper 1.0.8)

range = Range(Domain=Domain(0, 1), Steps=Slider(11, range=0..100))
y_length = Slider(47.319, range=0..50)
z_height = Slider(39.376, range=0..50)
graph_mapper = GraphMapper(
    range,
    x0=0,
    x1=1,
    y0=0,
    y1=1,
    container_name="Bezier",
    cpx=[0, 0.5106771588, 0.5925447941, 1],
    cpy=[0, 0.2403604388, 1, 0])  # disabled
petal_thickness = Slider(0.37, range=0..1)
graph_mapper_2 = GraphMapper(
    range,
    x0=0,
    x1=1,
    y0=0,
    y1=1,
    container_name="Bezier",
    cpx=[0, 0.8631074429, 0.3357903659, 1],
    cpy=[0, 0, 0.8419605494, 0.5311509371])
multiplication = Multiplication(A=range, B=y_length)
expression = Expression(x=graph_mapper, y=petal_thickness, Expression="pi/2*x*y")
multiplication_2 = Multiplication(A=graph_mapper_2, B=z_height)
addition = Addition(A=Slider(15, range=0..100), B=multiplication)
construct_point = ConstructPoint(XCoordinate=0, YCoordinate=addition, ZCoordinate=multiplication_2)
negative = Negative(Value=expression)
rotate = Rotate(Geometry=construct_point, Angle=negative, Plane=PlaneXY(0, 0, 0))  # -> Geometry, Transform
rotate_2 = Rotate(Geometry=construct_point, Angle=expression, Plane=PlaneXY(0, 0, 0))  # -> Geometry, Transform
interpolate = Interpolate(Vertices=rotate.Geometry, Degree=3, Periodic=False, KnotStyle=1)  # -> Curve, Length, Domain
interpolate_2 = Interpolate(Vertices=construct_point, Degree=3, Periodic=False, KnotStyle=1)  # -> Curve, Length, Domain
interpolate_3 = Interpolate(Vertices=rotate_2.Geometry, Degree=3, Periodic=False, KnotStyle=1)  # -> Curve, Length, Domain
expression_2 = Expression(x=Slider(1, range=0..10), Expression="2*pi*x")
loft = Loft(
    Curves=[interpolate.Curve, interpolate_2.Curve, interpolate_3.Curve],
    Options={Adjust=False, Closed=False, LoftEnds=0, LoftSimp=0, LoftType=0, Rebuild=10, Refit=0.01})
range_2 = Range(Domain=expression_2, Steps=Slider(14, range=0..100))
rotate_3 = Rotate(Geometry=loft, Angle=range_2, Plane=PlaneXY(0, 0, 0))  # -> Geometry, Transform

radius = Slider(54.451, range=0..70)
range_3 = Range(Domain=Domain(0, 1), Steps=Slider(72, range=0..100))
graph_mapper_3 = GraphMapper(
    range_3,
    x0=0,
    x1=1,
    y0=0,
    y1=1,
    container_name="Bezier",
    cpx=[0, 0.630992651, 0.1765984744, 1],
    cpy=[0, 0, 0.8821614385, 0.8714046478])
multiplication_3 = Multiplication(A=range_3, B=radius)
petal_height = Slider(50, range=0..50)
graph_mapper_4 = GraphMapper(
    range_3,
    x0=0,
    x1=1,
    y0=0,
    y1=1,
    container_name="Bezier",
    cpx=[0, 0.1316888332, 0.8578792214, 1],
    cpy=[0, 0.9717385173, 0.1538723111, 0])
thickness_oval = Slider(13, range=0..30)
width_of_oval = Slider(30, range=0..100)
multiplication_4 = Multiplication(A=graph_mapper_3, B=petal_height)
addition_2 = Addition(A=Slider(1.363, range=0..100), B=multiplication_3)
multiplication_5 = Multiplication(A=graph_mapper_4, B=width_of_oval)
multiplication_6 = Multiplication(A=graph_mapper_4, B=thickness_oval)
construct_point_2 = ConstructPoint(XCoordinate=0, YCoordinate=addition_2, ZCoordinate=multiplication_4)
ellipse = Ellipse(Plane=PlaneXY(0, 0, 0), Radius1=multiplication_5, Radius2=multiplication_6)  # -> Ellipse, Focus1, Focus2
construct_point_3 = ConstructPoint(XCoordinate=0, YCoordinate=0, ZCoordinate=0)
vector_2pt = Vector2Pt(PointA=construct_point_3, PointB=construct_point_2, Unitize=False)  # -> Vector, Length
move = Move(Geometry=ellipse.Ellipse, Motion=vector_2pt.Vector)  # -> Geometry, Transform
loft_2 = Loft(Curves=move.Geometry, Options={Adjust=False, Closed=False, LoftEnds=0, LoftSimp=0, LoftType=0, Rebuild=10, Refit=0.01})
cap_holes = CapHoles(Brep=loft_2)

top_number_petals = Slider(7, range=0..10)
top_petal_angle_fill = Slider(1.1, range=0..2)
expression_3 = Expression(x=Slider(1, range=0..10), y=top_petal_angle_fill, Expression="pi*x*y")
range_4 = Range(Domain=expression_3, Steps=top_number_petals)
rotate_4 = Rotate(Geometry=cap_holes, Angle=range_4, Plane=PlaneXY(0, 0, 0))  # -> Geometry, Transform
top_rotation = Slider(0.818, range=0..3)
expression_4 = Expression(x=top_rotation, Expression="pi*x")
rotate_5 = Rotate(Geometry=rotate_4.Geometry, Angle=expression_4, Plane=PlaneXY(0, 0, 0))  # -> Geometry, Transform

z_height_2 = Slider(0.135, range=0..10)
negative_2 = Negative(Value=z_height_2)
unit_z = UnitZ(Factor=negative_2)

number_slider = Slider(5, range=0..10)
yz_plane = YZPlane(Origin=Point(0, 0, 0))
rectangle = Rectangle(Plane=yz_plane, XSize=number_slider, YSize=number_slider, Radius=0)  # -> Rectangle, Length
unit_x = UnitX(Factor=Slider(40, range=0..100))
area = Area(Geometry=rectangle.Rectangle)  # -> Area, Centroid
construct_point_4 = ConstructPoint(XCoordinate=0, YCoordinate=0, ZCoordinate=Slider(20, range=0..70))
extrude = Extrude(Base=rectangle.Rectangle, Direction=unit_x)
yz_plane_2 = YZPlane(Origin=Point(0, 0, 0))
vector_2pt_2 = Vector2Pt(PointA=area.Centroid, PointB=construct_point_4, Unitize=False)  # -> Vector, Length
xy_plane = XYPlane(Origin=Point(0, 0, 0))
rotate_6 = Rotate(Geometry=extrude, Angle=Slider(44.9, range=0..45), Plane=yz_plane_2)  # -> Geometry, Transform
rotate_7 = Rotate(Geometry=rotate_6.Geometry, Angle=Slider(6.465, range=0..10), Plane=xy_plane)  # -> Geometry, Transform
move_2 = Move(Geometry=rotate_7.Geometry, Motion=vector_2pt_2.Vector)  # -> Geometry, Transform

number_slider_2 = Slider(13, range=0..100)
range_5 = Range(Domain=Domain(0, 1), Steps=number_slider_2)
radius_2 = Slider(50, range=0..50)
graph_mapper_5 = GraphMapper(
    range_5,
    x0=0,
    x1=1,
    y0=0,
    y1=1,
    container_name="Bezier",
    cpx=[0, 0.1454450041, 0.8575227261, 1],
    cpy=[0, 0.4596150517, 0.4921671748, 0])
thickness = Slider(0.756, range=0..2)
multiplication_7 = Multiplication(A=radius_2, B=graph_mapper_5)
ellipse_2 = Ellipse(Plane=PlaneXY(0, 0, 0), Radius1=multiplication_7, Radius2=multiplication_7)  # -> Ellipse, Focus1, Focus2
series = Series(Start=0, Step=thickness, Count=number_slider_2)
unit_z_2 = UnitZ(Factor=series)
move_3 = Move(Geometry=ellipse_2.Ellipse, Motion=unit_z_2)  # -> Geometry, Transform

move_4 = Move(Geometry=move_3.Geometry, Motion=unit_z)  # -> Geometry, Transform

loft_3 = Loft(Curves=move_4.Geometry, Options={Adjust=False, Closed=False, LoftEnds=0, LoftSimp=0, LoftType=0, Rebuild=10, Refit=0.01})

bottom_number_petals = Slider(6, range=0..10)
botton_petal_angles = Slider(1, range=0..10)
bottom_petal_angle_fill = Slider(1.3, range=0..2)
expression_5 = Expression(x=botton_petal_angles, y=bottom_petal_angle_fill, Expression="pi*x*y")
range_6 = Range(Domain=expression_5, Steps=bottom_number_petals)
bottom_angle = Slider(9.48929, range=0..10)
rotate_8 = Rotate(Geometry=cap_holes, Angle=range_6, Plane=PlaneXY(0, 0, 0))  # -> Geometry, Transform
xz_plane = XZPlane(Origin=Point(0, 0, 0))
rotate_9 = Rotate(Geometry=[rotate_8.Geometry, loft_3], Angle=bottom_angle, Plane=xz_plane)  # -> Geometry, Transform
move_5 = Move(Geometry=rotate_9.Geometry, Motion=Vector(0, 0, 10))  # -> Geometry, Transform

brep = Brep(flatten([move_5.Geometry, rotate_5.Geometry]))
data_dam = DataDam(DataA=brep, BufferDelay=10000000, BufferMode=0)
partition_list = PartitionList(List=data_dam, Size=Slider(2, range=0..2))
solid_union = SolidUnion(Breps=partition_list)
solid_union_2 = SolidUnion(Breps=solid_union)
